# Grasshopper definition wafflesimple.gh (Grasshopper 0.9.76)

number_slider = Slider(335, range=0..1000)
number_slider_2 = Slider(51, range=0..100)
planesrf = PlaneSurface(Plane=PlaneXY(0, 0, 0), XSize=number_slider, YSize=number_slider)
neg = Negative(Value=Slider(10, range=0..10))
sdivide = DivideSurface(Surface=planesrf, UCount=number_slider_2, VCount=number_slider_2)  # -> Points, Normals, Parameters
Z = UnitZ(Factor=neg)
move = Move(Geometry=planesrf, Motion=Z)  # -> Geometry, Transform
pdecon = Deconstruct(Point=sdivide.Points)  # -> XComponent, YComponent, ZComponent
bnd = Bounds(Numbers=flatten(pdecon.XComponent))
bnd_2 = Bounds(Numbers=flatten(pdecon.YComponent))
remap = RemapNumbers(Value=pdecon.XComponent, Source=bnd, Target=Domain(0, 1))  # -> Mapped, Clipped
remap_2 = RemapNumbers(Value=pdecon.YComponent, Source=bnd_2, Target=Domain(0, 1))  # -> Mapped, Clipped
pt = ConstructPoint(XCoordinate=remap.Mapped, YCoordinate=remap_2.Mapped, ZCoordinate=0)
image = ImageSampler(
    pt,
    FilePath="C:\Users\Administrator\Desktop\Waffle\Image\valley.jpg",
    Filter="Value",
    Interpolate=False,
    Umax=1,
    Umin=0,
    Vmax=1,
    Vmin=0,
    Wrap=1)
pt_2 = Point(sdivide.Points)
graph = GraphMapper(
    image,
    x0=0,
    x1=1,
    y0=0,
    y1=1,
    container_name="Bezier",
    cpx=[0, 0.6388399601, 0.3930433989, 1],
    cpy=[0, 0.3652175665, 0.5646380186, 1])
multiplication = Multiplication(A=graph, B=Slider(69, range=0..1000))
Z_2 = UnitZ(Factor=multiplication)
move_2 = Move(Geometry=pt_2, Motion=Z_2)  # -> Geometry, Transform
srfgrid = SurfaceFromPoints(Points=flatten(move_2.Geometry), UCount=expr("x+1", number_slider_2), Interpolate=False)
edges = BrepEdges(Brep=srfgrid)  # -> Naked, Interior, NonManifold
edges_2 = BrepEdges(Brep=move.Geometry)  # -> Naked, Interior, NonManifold
join = JoinCurves(Curves=edges.Naked, Preserve=False)
join_2 = JoinCurves(Curves=edges_2.Naked, Preserve=False)
panel = Panel(multiplication)
loft = Loft(Curves=[join_2, join], Options={Adjust=False, Closed=False, LoftEnds=0, LoftSimp=0, LoftType=0, Rebuild=10, Refit=0.01})
number_slider_3 = Slider(307, range=0..1000)
crv = Curve(<curve referenced from the Rhino model>)
Z_3 = UnitZ(Factor=number_slider_3)
Z_4 = UnitZ(Factor=expr("-x/2", number_slider_3))
extr = Extrude(Base=crv, Direction=Z_3)
move_3 = Move(Geometry=extr, Motion=Z_4)  # -> Geometry, Transform
join_3 = BrepJoin(Breps=flatten([loft, srfgrid, move.Geometry]))  # -> Breps, Closed
cap = CapHoles(Brep=move_3.Geometry)
sint = SolidIntersection(BrepsA=join_3.Breps, BrepsB=cap)
bbox = BoundingBox(Content=sint, Plane=PlaneXY(0, 0, 0))  # -> Box, Box_2
box_corners = BoxCorners(Box=bbox.Box)  # -> CornerA, CornerB, CornerC, CornerD, CornerE, CornerF, CornerG, CornerH
pt_3 = Point(box_corners.CornerD)
pt_4 = Point(box_corners.CornerA)
pt_5 = Point(box_corners.CornerB)
Y = UnitY(Factor=1)
X = UnitX(Factor=1)
dist = Distance(PointA=pt_4, PointB=pt_5)
rad = Radians(Degrees=Slider(125, range=0..1000))
dist_2 = Distance(PointA=pt_4, PointB=pt_3)
Z_5 = UnitZ(Factor=1)
rad_2 = Radians(Degrees=Slider(77, range=0..1000))
Z_6 = UnitZ(Factor=1)
vrot = Rotate(Vector=X, Axis=Z_5, Angle=rad)
division = Division(A=dist, B=Slider(32, range=0..100))
vrot_2 = Rotate(Vector=Y, Axis=Z_6, Angle=rad_2)
division_2 = Division(A=dist_2, B=Slider(11, range=0..100))
contour = Contour(Shape=sint, Point=pt_4, Direction=vrot, Distance=division)
contour_2 = Contour(Shape=sint, Point=pt_4, Direction=vrot_2, Distance=division_2)
boundary = BoundarySurfaces(Edges=contour)
boundary_2 = BoundarySurfaces(Edges=contour_2)
preview = CustomPreview(
    Geometry=[boundary_2, boundary],
    Shader={ambient=RGB(0, 0, 0), diffuse=RGB(255, 105, 180), emission=RGB(76, 32, 54), shine=0.5, specular=RGB(255, 255, 255), transparency=0})
